# Grasshopper definition bricks.gh (Grasshopper 1.0.7)

number_slider = Slider(0.65, range=0..1)
number_slider_2 = Slider(1.2, range=0..10)
number_slider_3 = Slider(10, range=0..10)
pt = Point(Point(0, 0, 0))

series = Series(Start=0, Step=expr("x+0.1", number_slider), Count=number_slider_3)
series_2 = Series(Start=0, Step=expr("x+0.1", number_slider_2), Count=number_slider_3)
X = UnitX(Factor=series)
Z = UnitZ(Factor=series_2)  # -> graft(UnitVector)
move = Move(Geometry=pt, Motion=X)  # -> Geometry, Transform
move_2 = Move(Geometry=move.Geometry, Motion=Z)  # -> Geometry, Transform
box = CenterBox(
    Base=move_2.Geometry,
    X=expr("x/2", number_slider),
    Y=expr("x/2", Slider(2.4, range=0..10)),
    Z=expr("x/2", number_slider_2))
geo = Geometry(box)

python = GhPythonScript(
    x=Slider(100, range=0..100),
    upper_threshold=Slider(0.6, range=0..1),
    lower_threshold=Slider(0.4, range=0..1),
    seed=Slider(5, range=0..10),
    save_csv=Toggle(False))  # -> out, list; inputs x: Int32, seed: Int32
# ---------- python: Python ----------
__author__ = "Jacek"
__version__ = "2022.09.13"

import rhinoscriptsyntax as rs
import random
import csv


random.seed(30)

random_list = []
for _ in range(x):
    r = random.random()
    if r > upper_threshold:
        random_list.append(1)
    elif r < lower_threshold:
        random_list.append(-1)
    else:
        random_list.append(0)
list = random_list

data = [[i, random_list[i]]for i in range(x)]
path = r'C:\Users\Jacek\Desktop\magisterka\model\bricks.csv'
if save_csv:
    with open(path, "wb") as csvfile:
        csvwriter = csv.writer(csvfile,  delimiter=';')
        csvwriter.writerows(data)
# ---------- end python ----------
multiplication = Multiplication(A=python.list, B=Slider(0.5, range=0..1))
Y = UnitY(Factor=multiplication)
move_3 = Move(Geometry=flatten(geo), Motion=Y)  # -> Geometry, Transform
